# Grasshopper definition Rooms to surfaces.gh (Grasshopper 1.0.7)
# plug-ins: Rhino.Inside for Autodesk Revit, eleFront

categories = QueryCategories(Type=1, Name="Rooms", IsVisibleUI=True, IsSubcategory=False)
catfltr = CategoryFilter(Categories=categories, Inverted=False)
elements = QueryElements(Filter=catfltr)  # -> Elements, Count
txt = Text(elements.Elements)
tmatch = MatchText(Text=txt, RegEx="BED", Case=True)
cull = CullPattern(List=elements.Elements, CullPattern=tmatch)
geometry = ElementGeometry(Elements=cull)  # -> flatten(Geometry)
bbox = BoundingBox(Content=geometry, Plane=PlaneXY(0, 0, 0))  # -> Box, Box_2
box = EvaluateBox(Box=bbox.Box, UParameter=0.5, VParameter=0.5, WParameter="0.0")  # -> Plane, Point, Include
sec = BrepPlane(Brep=geometry, Plane=box.Plane)  # -> Curves, Points
srf = Surface(flatten(sec.Curves))
_1000 = Panel("0")
flip = Flip(Surface=srf)  # -> Surface, Result
genpts = LBGeneratePointGrid(geometry=flip.Surface, grid_size="500", offset_dist=_1000, quad_only=Toggle(True))  # -> points, vectors, face_areas, flatten(mesh); plug-in component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
passport = ElementPassport(Element=cull)  # -> DocumentGUID, Document, UniqueID, Id
ef_att = EleFrontAttributes(Name=passport.Id, Layer="Testing::Meshes")  # -> Attributes, Keys, Values, Name, Layer, ColourSource, DisplayColour, MaterialSource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
bake = BakeObjects(Geometry=genpts.mesh, Attributes=ef_att.Attributes, BakeName="Testing::Meshes", Bake=False, createGroups=False)  # -> Message, Ghosts
