# Grasshopper definition Solar analysis RiR.gh (Grasshopper 1.0.7)
# plug-ins: eleFront, Rhino.Inside for Autodesk Revit

location = ProjectLocation()  # -> SiteLocation, SharedSite, SurveyPoint, ProjectBasePoint
param = ElementParameter(Element=location.ProjectBasePoint, Parameter="Angle to True North")  # -> Element, Value
convergence = Panel("-1")
path = FilePath("C:\Users\Gavin\Downloads\PROJECT FOLDER\NEST1\SOFTWARE\RHINO\250710_Solar study\Gh\AUS_NSW.Sydney.947670_IWEC.epw")
deg = Degrees(Radians=param.Value)
analysisperiod = LBAnalysisPeriod(start_month="6", start_day="21", start_hour="9", end_month="6", end_day="21", end_hour="15", timestep="12")  # -> period, hoys, dates; plug-in component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
importloc = LBImportLocation(epw_file=path)  # -> location; plug-in component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
reflay = ReferenceByLayer(LayerName="Building", lightweight=False)
reflay_2 = ReferenceByLayer(LayerName="Context", lightweight=False)
reflay_3 = ReferenceByLayer(LayerName="Shading", lightweight=False)
addition = Addition(A=deg, B=convergence)
merge = Merge(Data1=reflay_2, Data2=reflay)
sunpath = LBSunPath(north=addition, location=importloc, hoys=analysisperiod.hoys, scale=1)  # -> report, vectors, altitudes, azimuths, hoys, sun_pts, analemma, daily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; plug-in component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
reflay_4 = ReferenceByLayer(LayerName="Testing::Meshes", lightweight=False)
mjoin = MeshJoin(Meshes=merge)
run = BooleanToggle(True)
txt = Text(reflay_4)
directsunhours = LBDirectSunHours(
    vectors=flatten(sunpath.vectors),
    timestep="12",
    geometry=flatten(reflay_4),
    context=flatten(mjoin),
    grid_size="500",
    offset_dist="1000",
    run=run)  # -> report, points, results, mesh, legend, title, int_mtx; plug-in component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
split = TextSplit(Text=txt, Separators=":")
rhatt = GetRhinoAttributes(Geometry=reflay_4, fullpath=False)  # -> Name, Layer, Color, MaterialName, SourceFile
item = ListItem(List=split, Index="-1", Wrap=True)  # -> flatten(Item)
rep = ReplaceText(Text=item, Find=")", RecursiveReplace=False)
num = Number(rep)
partition = PartitionList(List=directsunhours.results, Size=num)  # -> simplify(Chunks)
bnd = Bounds(Numbers=partition)
dedomain = DeconstructDomain(Domain=bnd)  # -> Start, flatten(End)
element = QueryElement(Id=rhatt.Name)
filter = StreamFilter(Gate=Button(), Stream1=element)
param_2 = ElementParameter(Element=filter, Parameter="MAX SUN HOURS", Value=dedomain.End)  # -> Element, Value
